# Grasshopper definition Firefly_Controller.gh (Grasshopper 1.0.7)
# plug-ins: Firefly.Core

trigger = Trigger(Interval=100, TimerInterval=100, Target=read)
open_port = OpenClosePort(OpenClosePort=Toggle(True), PortNumber="6", BaudRate="9600")
read = SerialReadGeneric(StartReadingValues=Toggle(True), PortNumber="6")  # -> SerialOutput, StatusMessage
panel = Panel(read.SerialOutput)
panel_2 = Panel(open_port)
split = TextSplit(Text=panel, Separators=",")
item = ListItem(List=split, Index=2, Wrap=True)
item_2 = ListItem(List=split, Index=3, Wrap=True)
item_3 = ListItem(List=split, Index=1, Wrap=True)
panel_3 = Panel(item_3)
panel_4 = Panel(item)
panel_5 = Panel(item_2)

item_4 = ListItem(List=split, Index=0, Wrap=True)
item_5 = ListItem(List=split, Index=4, Wrap=True)
panel_6 = Panel(item_4)
panel_7 = Panel(item_5)
dom = ConstructDomain(DomainStart="1", DomainEnd="10")
dom_2 = ConstructDomain(DomainStart="0", DomainEnd="18")
dom_3 = ConstructDomain(DomainStart="1", DomainEnd="10")
dom_4 = ConstructDomain(DomainStart="0", DomainEnd="18")
dom_5 = ConstructDomain(DomainStart="0", DomainEnd="100")
dom_6 = ConstructDomain(DomainStart="0", DomainEnd="1023")
dom_7 = ConstructDomain(DomainStart="3", DomainEnd="12")
dom_8 = ConstructDomain(DomainStart="0", DomainEnd="5")
dom_9 = ConstructDomain(DomainStart="0", DomainEnd="1023")
dom_10 = ConstructDomain(DomainStart="0", DomainEnd="1023")
remap = RemapNumbers(Value=panel_7, Source=dom_2, Target=dom)  # -> Mapped, Clipped
remap_2 = RemapNumbers(Value=panel_6, Source=dom_4, Target=dom_3)  # -> Mapped, Clipped
remap_3 = RemapNumbers(Value=panel_5, Source=dom_6, Target=dom_5)  # -> Mapped, Clipped
remap_4 = RemapNumbers(Value=panel_4, Source=dom_9, Target=dom_7)  # -> Mapped, Clipped
remap_5 = RemapNumbers(Value=panel_3, Source=dom_10, Target=dom_8)  # -> Mapped, Clipped
polygon = Polygon(Plane=PlaneXY(0, 0, 0), Radius=Slider(7, range=1..12), Segments=remap_4.Mapped, FilletRadius=remap_5.Mapped)  # -> Polygon, Length
Z = UnitZ(Factor=remap_3.Mapped)
extr = Extrude(Base=polygon.Polygon, Direction=Z)
scale = Scale(Geometry=extr, Center=Point(0, 0, 0), Factor=remap_2.Mapped)  # -> Geometry, Transform
