# Grasshopper definition keycap_files_gh 2.gh (Grasshopper 1.0.7)
# plug-ins: Pufferfish

v_count = Slider(5, range=0..20)
u_count = Slider(15, range=0..20)
v_count_2 = Slider(10, range=0..20)
u_count_2 = Slider(3, range=0..20)
v_count_3 = Slider(9, range=0..20)
v_count_4 = Slider(13, range=0..20)
u_count_3 = Slider(10, range=0..20)
u_count_4 = Slider(1, range=0..20)
v_count_5 = Slider(11, range=0..20)
u_count_5 = Slider(1, range=0..20)
v_count_6 = Slider(9, range=0..20)
u_count_6 = Slider(1, range=0..20)
v_count_7 = Slider(7, range=0..20)
u_count_7 = Slider(1, range=0..20)
# created a keycap to make into a pattern
number_slider = Slider(16, range=0..100)
number_slider_2 = Slider(65, range=0..100)
# LEFT
curve = Curve([<curve referenced from the Rhino model> x20])
# RIGHT
curve_2 = Curve([<curve referenced from the Rhino model> x18])
v_count_8 = Slider(20, range=0..20)
u_count_8 = Slider(5, range=0..20)
curve_3 = Curve([<curve referenced from the Rhino model> x4])
curve_4 = Curve([<curve referenced from the Rhino model> x3])
number_slider_3 = Slider(8.148, range=0..80)
number_slider_4 = Slider(1.212, range=0..80)
loft = Loft(Curves=curve_3, Options={Adjust=True, Closed=False, LoftEnds=0, LoftSimp=0, LoftType=0, Rebuild=10, Refit=0.01})
bounding_box = BoundingBox(Content=curve_2, Plane=PlaneXY(0, 0, 0), UnionBox=True)  # -> Box, Box_2
surface = Surface(<surface referenced from the Rhino model>)
divide_domain² = DivideDomain²(Domain=surface, UCount=u_count, VCount=v_count)
construct_point = ConstructPoint(XCoordinate=expr("x/2", number_slider), YCoordinate=expr("x/2", number_slider_2), ZCoordinate=Slider(0, range=0..100))
construct_point_2 = ConstructPoint(XCoordinate=expr("x/2", number_slider), YCoordinate=expr("x/2", number_slider_2), ZCoordinate=Slider(9.6, range=0..10))
surface_2 = Surface([<surface referenced from the Rhino model> x4])
surface_3 = Surface()
divide_domain²_2 = DivideDomain²(Domain=surface_3, UCount=u_count_2, VCount=v_count_2)
rectangle = Rectangle(Plane=PlaneXY(0, 0, 0), XSize=number_slider, YSize=number_slider_2, Radius=Slider(3, range=0..10))  # -> Rectangle, Length
surface_4 = Surface(<surface referenced from the Rhino model>)
divide_domain²_3 = DivideDomain²(Domain=surface_4, UCount=u_count_3, VCount=v_count_3)
surface_5 = Surface(<surface referenced from the Rhino model>)
divide_domain²_4 = DivideDomain²(Domain=surface_5, UCount=u_count_4, VCount=v_count_4)
surface_6 = Surface(<surface referenced from the Rhino model>)
divide_domain²_5 = DivideDomain²(Domain=surface_6, UCount=u_count_5, VCount=v_count_5)
surface_7 = Surface(<surface referenced from the Rhino model>)
divide_domain²_6 = DivideDomain²(Domain=surface_7, UCount=u_count_6, VCount=v_count_6)
polygon = Polygon(Plane=PlaneXY(165, 53, 0), Radius=3, Segments=6, FilletRadius=0)  # -> Polygon, Length
surface_8 = Surface(<surface referenced from the Rhino model>)
divide_domain²_7 = DivideDomain²(Domain=surface_8, UCount=u_count_7, VCount=v_count_7)
hexagonal = Hexagonal(Plane=surface_2, Size=1, ExtentX=u_count_8, ExtentY=v_count_8)  # -> Cells, Points
isotrim = Isotrim(Surface=surface, Domain=divide_domain²)
isotrim_2 = Isotrim(Surface=surface_3, Domain=divide_domain²_2)
isotrim_3 = Isotrim(Surface=surface_4, Domain=divide_domain²_3)
isotrim_4 = Isotrim(Surface=surface_5, Domain=divide_domain²_4)
isotrim_5 = Isotrim(Surface=surface_6, Domain=divide_domain²_5)
isotrim_6 = Isotrim(Surface=surface_7, Domain=divide_domain²_6)
isotrim_7 = Isotrim(Surface=surface_8, Domain=divide_domain²_7)
line = Line(StartPoint=construct_point, EndPoint=construct_point_2)
isotrim_8 = Isotrim(Surface=surface_2, Domain=hexagonal.Points)
area = Area(Geometry=isotrim)  # -> Area, Centroid
area_2 = Area(Geometry=isotrim_2)  # -> Area, Centroid
# i listed out indices or points i didn't want from the list. (using the multiple integers in the indices.
join_curves = JoinCurves(Curves=isotrim, Preserve=False)
area_3 = Area(Geometry=isotrim_3)  # -> Area, Centroid
area_4 = Area(Geometry=isotrim_4)  # -> Area, Centroid
join_curves_2 = JoinCurves(Curves=isotrim_2, Preserve=False)
geometry = Geometry(<brep referenced from the Rhino model>)
area_5 = Area(Geometry=isotrim_5)  # -> Area, Centroid
join_curves_3 = JoinCurves(Curves=isotrim_3, Preserve=False)
join_curves_4 = JoinCurves(Curves=isotrim_4, Preserve=False)
geometry_2 = Geometry(<brep referenced from the Rhino model>)
area_6 = Area(Geometry=isotrim_6)  # -> Area, Centroid
join_curves_5 = JoinCurves(Curves=isotrim_5, Preserve=False)
geometry_3 = Geometry(<brep referenced from the Rhino model>)
geometry_4 = Geometry(<brep referenced from the Rhino model>)
area_7 = Area(Geometry=isotrim_7)  # -> Area, Centroid
join_curves_6 = JoinCurves(Curves=isotrim_6, Preserve=False)
geometry_5 = Geometry(<brep referenced from the Rhino model>)
join_curves_7 = JoinCurves(Curves=isotrim_7, Preserve=False)
geometry_6 = Geometry(<brep referenced from the Rhino model>)
geometry_7 = Geometry(<brep referenced from the Rhino model>)
# RIGHT HERE
volume = Volume(Geometry=geometry)  # -> Volume, Centroid
# RIGHT HERE
volume_2 = Volume(Geometry=geometry_2)  # -> Volume, Centroid
# RIGHT HERE
volume_3 = Volume(Geometry=geometry_3)  # -> Volume, Centroid
# RIGHT HERE
volume_4 = Volume(Geometry=geometry_4)  # -> Volume, Centroid
# RIGHT HERE
volume_5 = Volume(Geometry=geometry_5)  # -> Volume, Centroid
panel = Panel(area.Centroid)
# RIGHT HERE
volume_6 = Volume(Geometry=geometry_6)  # -> Volume, Centroid
panel_2 = Panel(area_2.Centroid)
# RIGHT HERE
volume_7 = Volume(Geometry=geometry_7)  # -> Volume, Centroid
panel_3 = Panel(area_3.Centroid)
panel_4 = Panel(area_4.Centroid)
panel_5 = Panel(area_5.Centroid)
panel_6 = Panel(area_6.Centroid)
panel_7 = Panel(area_7.Centroid)
extrude_tapered_polysurface = ExtrudeTaperedPolysurface(Profile=rectangle.Rectangle, Direction=line, Angle=Slider(10, range=0..10), CornerType=0, FaceMerge=True)
xy_plane = XYPlane(Origin=volume.Centroid)
xy_plane_2 = XYPlane(Origin=volume_2.Centroid)
xy_plane_3 = XYPlane(Origin=volume_3.Centroid)
xy_plane_4 = XYPlane(Origin=volume_4.Centroid)
xy_plane_5 = XYPlane(Origin=volume_5.Centroid)
cull_index = CullIndex(List=panel, Indices=[0, 1, 2, 3, 4, 5, 6, 7, 8, 9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], Wrap=True)
xy_plane_6 = XYPlane(Origin=volume_6.Centroid)
cull_index_2 = CullIndex(
    List=panel_2,
    Indices=[0, 1, 2, 3, 4, 7, 8, 9, 10, 11, 12, 13, 14, 17, 18, 19, 20, 21, 22, 23, 24, 27, 28, 29],
    Wrap=True)
xy_plane_7 = XYPlane(Origin=volume_7.Centroid)
cull_index_3 = CullIndex(
    List=panel_3,
    Indices=[0, 1, 2, 3, 5, 6, 7, 8, 9, 10, 11, 12, 13, 14, 15, 16, 17, 18, 19, 20, 21, 22, 23, 25, 26, 27, 28, 29],
    Wrap=True)
cull_index_4 = CullIndex(List=panel_4, Indices=[0, 2, 4, 6, 8, 10, 12], Wrap=True)
cull_index_5 = CullIndex(List=panel_5, Indices=[0, 2, 4, 6, 8, 10], Wrap=True)
cap_holes = CapHoles(Brep=extrude_tapered_polysurface)
cull_index_6 = CullIndex(List=panel_6, Indices=[0, 2, 4, 6, 8], Wrap=True)
cull_index_7 = CullIndex(List=panel_7, Indices=[0, 6], Wrap=True)
surface_closest_point = SurfaceClosestPoint(Point=cull_index, Surface=surface)  # -> Point, UVPoint, Distance
surface_closest_point_2 = SurfaceClosestPoint(Point=cull_index_2, Surface=surface_3)  # -> Point, UVPoint, Distance
surface_closest_point_3 = SurfaceClosestPoint(Point=cull_index_3, Surface=surface_4)  # -> Point, UVPoint, Distance
surface_closest_point_4 = SurfaceClosestPoint(Point=cull_index_4, Surface=surface_5)  # -> Point, UVPoint, Distance
surface_closest_point_5 = SurfaceClosestPoint(Point=cull_index_5, Surface=surface_6)  # -> Point, UVPoint, Distance
surface_closest_point_6 = SurfaceClosestPoint(Point=cull_index_6, Surface=surface_7)  # -> Point, UVPoint, Distance
surface_closest_point_7 = SurfaceClosestPoint(Point=cull_index_7, Surface=surface_8)  # -> Point, UVPoint, Distance
shell_polysurface = ShellPolysurface(Polysurface=cap_holes, Removal=Slider(2, range=0..2), Thickness=Slider(1, range=0..1), FaceMerge=False)
evaluate_surface = EvaluateSurface(Surface=surface, Point=surface_closest_point.UVPoint)  # -> Point, Normal, UDirection, VDirection, Frame
orient = Orient(Geometry=geometry, Source=xy_plane, Target=evaluate_surface.Frame)  # -> Geometry, Transform
evaluate_surface_2 = EvaluateSurface(Surface=surface_3, Point=surface_closest_point_2.UVPoint)  # -> Point, Normal, UDirection, VDirection, Frame
orient_2 = Orient(Geometry=geometry_2, Source=xy_plane_2, Target=evaluate_surface_2.Frame)  # -> Geometry, Transform
evaluate_surface_3 = EvaluateSurface(Surface=surface_4, Point=surface_closest_point_3.UVPoint)  # -> Point, Normal, UDirection, VDirection, Frame
orient_3 = Orient(Geometry=geometry_3, Source=xy_plane_3, Target=evaluate_surface_3.Frame)  # -> Geometry, Transform
evaluate_surface_4 = EvaluateSurface(Surface=surface_5, Point=surface_closest_point_4.UVPoint)  # -> Point, Normal, UDirection, VDirection, Frame
orient_4 = Orient(Geometry=geometry_4, Source=xy_plane_4, Target=evaluate_surface_4.Frame)  # -> Geometry, Transform
evaluate_surface_5 = EvaluateSurface(Surface=surface_6, Point=surface_closest_point_5.UVPoint)  # -> Point, Normal, UDirection, VDirection, Frame
orient_5 = Orient(Geometry=geometry_5, Source=xy_plane_5, Target=evaluate_surface_5.Frame)  # -> Geometry, Transform
evaluate_surface_6 = EvaluateSurface(Surface=surface_7, Point=surface_closest_point_6.UVPoint)  # -> Point, Normal, UDirection, VDirection, Frame
orient_6 = Orient(Geometry=geometry_6, Source=xy_plane_6, Target=evaluate_surface_6.Frame)  # -> Geometry, Transform
evaluate_surface_7 = EvaluateSurface(Surface=surface_8, Point=surface_closest_point_7.UVPoint)  # -> Point, Normal, UDirection, VDirection, Frame
orient_7 = Orient(Geometry=geometry_7, Source=xy_plane_7, Target=evaluate_surface_7.Frame)  # -> Geometry, Transform
v_count_9 = Slider(16, range=0..20)
u_count_9 = Slider(9, range=0..20)
v_count_10 = Slider(5, range=0..20)
u_count_10 = Slider(15, range=0..20)
v_count_11 = Slider(15, range=0..20)
u_count_11 = Slider(3, range=0..20)
surface_9 = Surface(<surface referenced from the Rhino model>)
divide_domain²_8 = DivideDomain²(Domain=surface_9, UCount=u_count_9, VCount=v_count_9)
surface_10 = Surface(<surface referenced from the Rhino model>)
divide_domain²_9 = DivideDomain²(Domain=surface_10, UCount=u_count_10, VCount=v_count_10)
surface_11 = Surface(<surface referenced from the Rhino model>)
divide_domain²_10 = DivideDomain²(Domain=surface_11, UCount=u_count_11, VCount=v_count_11)
isotrim_9 = Isotrim(Surface=surface_9, Domain=divide_domain²_8)
isotrim_10 = Isotrim(Surface=surface_10, Domain=divide_domain²_9)
isotrim_11 = Isotrim(Surface=surface_11, Domain=divide_domain²_10)
area_8 = Area(Geometry=isotrim_9)  # -> Area, Centroid
area_9 = Area(Geometry=isotrim_10)  # -> Area, Centroid
join_curves_8 = JoinCurves(Curves=isotrim_9, Preserve=False)
area_10 = Area(Geometry=isotrim_11)  # -> Area, Centroid
join_curves_9 = JoinCurves(Curves=isotrim_10, Preserve=False)
geometry_8 = Geometry(<brep referenced from the Rhino model>)
join_curves_10 = JoinCurves(Curves=isotrim_11, Preserve=False)
geometry_9 = Geometry(<brep referenced from the Rhino model>)
geometry_10 = Geometry(<brep referenced from the Rhino model>)
# RIGHT HERE
volume_8 = Volume(Geometry=geometry_8)  # -> Volume, Centroid
# RIGHT HERE
volume_9 = Volume(Geometry=geometry_9)  # -> Volume, Centroid
# RIGHT HERE
volume_10 = Volume(Geometry=geometry_10)  # -> Volume, Centroid
panel_8 = Panel(area_8.Centroid)
panel_9 = Panel(area_9.Centroid)
panel_10 = Panel(area_10.Centroid)
xy_plane_8 = XYPlane(Origin=volume_8.Centroid)
xy_plane_9 = XYPlane(Origin=volume_9.Centroid)
xy_plane_10 = XYPlane(Origin=volume_10.Centroid)
cull_index_8 = CullIndex(List=panel_8, Indices=[0, 2, 4, 6, 8, 10, 12], Wrap=True)
cull_index_9 = CullIndex(List=panel_9, Indices=[0, 1, 2, 3, 4, 5, 6, 7, 8, 9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], Wrap=True)
cull_index_10 = CullIndex(List=panel_10, Indices=[0, 1, 2, 3, 4, 5, 6, 7, 8, 9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], Wrap=True)
point = Point([<point referenced from the Rhino model> x6])
surface_closest_point_8 = SurfaceClosestPoint(Point=point, Surface=surface_9)  # -> Point, UVPoint, Distance
surface_closest_point_9 = SurfaceClosestPoint(Point=cull_index_9, Surface=surface_10)  # -> Point, UVPoint, Distance
surface_closest_point_10 = SurfaceClosestPoint(Point=cull_index_10, Surface=surface_11)  # -> Point, UVPoint, Distance
evaluate_surface_8 = EvaluateSurface(Surface=surface_9, Point=surface_closest_point_8.UVPoint)  # -> Point, Normal, UDirection, VDirection, Frame
orient_8 = Orient(Geometry=geometry_8, Source=xy_plane_8, Target=evaluate_surface_8.Frame)  # -> Geometry, Transform
evaluate_surface_9 = EvaluateSurface(Surface=surface_10, Point=surface_closest_point_9.UVPoint)  # -> Point, Normal, UDirection, VDirection, Frame
orient_9 = Orient(Geometry=geometry_9, Source=xy_plane_9, Target=evaluate_surface_9.Frame)  # -> Geometry, Transform
evaluate_surface_10 = EvaluateSurface(Surface=surface_11, Point=surface_closest_point_10.UVPoint)  # -> Point, Normal, UDirection, VDirection, Frame
orient_10 = Orient(Geometry=geometry_10, Source=xy_plane_10, Target=evaluate_surface_10.Frame)  # -> Geometry, Transform
